vi "IndoorMonitoring.gviweb"   [LabVIEW NXG 3.0.0]
panel controls:
  "Tab": i32
  "Node Files 1": i32 = -1
panel indicators:
  "NodeTemp1": f64
  "NodeRH1": f64
  "NodeTemp2": f64
  "NodeRH2": f64
  "String Info Node 1": string
  "String Info Node 2": string
  "status": bool
  "AVG T Graphs": cluster{"Element 1": f64[], "Element 2": f64[]}[]
  "Update Time": string
  "T HistMinMax": cluster{"Element 1": f64[], "Element 2": f64[]}[]
  "T summary node 1": string
  "T summary node 2": string
  "RH summary node 1": string
  "RH summary node 2": string
  "String Info Node 3": string
  "NodeTemp3": f64
  "NodeRH3": f64
  "AVG RH Graphs": cluster{"Element 1": f64[], "Element 2": f64[]}[]
  "File T Graphs": cluster{"Element 1": f64[], "Element 2": f64[]}[]
  "File RH Graphs": cluster{"Element 1": f64[], "Element 2": f64[]}[]
  "T summary node 3": string
  "RH summary node 3": string
  "RH HistMinMax": cluster{"Element 1": f64[], "Element 2": f64[]}[]
uses:
  WebApp::UI_Functions::UIFunctions_init.gvi
  WebApp::UI_Functions::UIFunctions_GetDebug.gvi
  WebApp::UI_Functions::UIFunctions_GetActualValues.gvi
  WebApp::UI_Functions::UIFunctions_GetAveragedValues.gvi
  WebApp::UI_Functions::UIFunctions_GetFileList.gvi
  WebApp::UI_Functions::UIFunctions_GetMinMaxValues.gvi
  WebApp::UI_Functions::UIFunctions_GetFileData.gvi
diagram:
  Property Node(instance in=reference to "Tab", "Value"=0) -> (instance out=w1)
  call "UIFunctions_init.gvi"(Ip adresses of nodes=["192.168.178.67", "192.168.178.144", "192.168.178.191"], ListBoxRef=reference to "Node Files 1") -> (UIFunction_Out=w2)
  s1 = w2  # shift register
  s2 = 10  # shift register
  while (after w1) {
    w3 = $Tab
    event (timeout = s2) (after w3) {
      on Timeout {
        Get Date And Time String(want seconds? (F)=TRUE) -> (time string=w7)
        call "UIFunctions_GetDebug.gvi"(UIFunction_In=s1) -> (UIFunction_Out=w8, DebugStrings=w9, Error Out=w10)
        Array Index(array=w9) -> (out0[_]=w11, out1[_]=w12, out2[_]=w13)
        $"String Info Node 1" <- w11
        $"String Info Node 2" <- w12
        $"String Info Node 3" <- w13
        call "UIFunctions_GetActualValues.gvi"(UIFunction_In=w8, Error In=w10) -> (UIFunction_Out=w14, ActualValues=w15, Error Out=w16)
        Array Index(array=w15) -> (out0[_]=w17, out1[_]=w18, out2[_]=w19)
        Property Node(instance in=w17) -> ("Temp"=w20, "RH"=w21)
        $NodeTemp1 <- w20
        $NodeRH1 <- w21
        Property Node(instance in=w18) -> ("Temp"=w22, "RH"=w23)
        $NodeTemp2 <- w22
        $NodeRH2 <- w23
        call "UIFunctions_GetAveragedValues.gvi"(UIFunction_In=w14, Error In=w16) -> (UIFunction_Out=w4, T Graphs=w24, RH Graphs=w25, Error Out=w5)
        $"AVG T Graphs" <- w24
        $"AVG RH Graphs" <- w25
        Property Node(instance in=w19) -> ("Temp"=w26, "RH"=w27)
        $NodeTemp3 <- w26
        $NodeRH3 <- w27
        w6 = 15000
      }
      on "Tab" Value changed {
        Get Date And Time String(want seconds? (F)=TRUE) -> (time string=w7)
        Event Data() -> ("New Value"=w28)
        case (w28) {
          frame 0, Default {
            w4 = s1
            w5 = default
          }
          frame 1 {
            # Update the file list of each node
            call "UIFunctions_GetFileList.gvi"(UIFunction_In=s1) -> (UIFunction_Out=w4, Error Out=w5)
          }
          frame 2, 3 {
            call "UIFunctions_GetMinMaxValues.gvi"(UIFunction_In=s1) -> (UIFunction_Out=w4, T Graphs=w29, RH Graphs=w30, Error Out=w5, T Strings=w31, RH Strings=w32)
            # Get the hostorical min and max for each node - takes some time to process
            Array Index(array=w31) -> (out0[_]=w33, out1[_]=w34, out2[_]=w35)
            $"T summary node 1" <- w33
            $"T summary node 2" <- w34
            $"T summary node 3" <- w35
            Array Index(array=w32) -> (out0[_]=w36, out1[_]=w37, out2[_]=w38)
            $"RH summary node 1" <- w36
            $"RH summary node 2" <- w37
            $"RH summary node 3" <- w38
            $"T HistMinMax" <- w29
            $"RH HistMinMax" <- w30
          }
        }
        w6 = s2
      }
      on "Node Files 1" Value changed {
        Get Date And Time String(want seconds? (F)=TRUE) -> (time string=w7)
        call "UIFunctions_GetFileData.gvi"(UIFunction_In=s1) -> (UIFunction_Out=w4, T Graphs=w39, RH Graphs=w40, Error Out=w5)
        $"File T Graphs" <- w39
        $"File RH Graphs" <- w40
        w6 = s2
      }
    }
    $"Update Time" <- w7
    Property Node(instance in=w5) -> ("status"=w41)
    $status <- w41
    next s1 = w4
    next s2 = w6
    stop if FALSE
  }
